# Grasshopper definition WS_Example_001.gh (Grasshopper 1.0.7)
# plug-ins: Hops, Kangaroo2 Components

# Opening File Content
panel = Panel("person.txt")
# Reading Files Contents
panel_2 = Panel("Colors.txt")
# Looping through a File with readlines()
panel_3 = Panel("Colors.txt")
# Looping through a File with readline()
# while loop
panel_4 = Panel("quotes.txt")
# Enumerate through a File
panel_5 = Panel("quotes.txt")
# Moving the pointer with seek()
panel_6 = Panel("quotes.txt")
# Looping through a File with readline()
# while loop with a counter = 1
panel_7 = Panel("quotes.txt")
# Appending verses overwriting files
panel_8 = Panel("quotes.txt")
# Using tell() to determine the pointer location in a file
panel_9 = Panel("quotes.txt")
panel_10 = Panel("0")
panel_11 = Panel("151")
enumerated_txt = Hops(
    Filename="quotes.txt",
    CacheResultsInMemory=False,
    CacheSolveResults=False,
    RemoteDefinitionLocation="http://127.0.0.1:5000/enumerated_txt",
    RemoteSolveVersion=(0, 1, 0),
    ShowInput_Enabled=False,
    ShowInput_Path=False,
    SynchronousSolve=True)
append_new_txt = Hops(
    Filename=panel_8,
    Newline="Michael Wickerson",
    CacheResultsInMemory=False,
    CacheSolveResults=False,
    RemoteDefinitionLocation="http://127.0.0.1:5000/append_new_txt",
    RemoteSolveVersion=(0, 1, 0),
    ShowInput_Enabled=False,
    ShowInput_Path=False,
    SynchronousSolve=True)
loop_counter_readline_txt = Hops(
    Filename=panel_7,
    CacheResultsInMemory=True,
    CacheSolveResults=True,
    RemoteDefinitionLocation="http://127.0.0.1:5000/loop_counter_readline_txt",
    RemoteSolveVersion=(0, 1, 0),
    ShowInput_Enabled=False,
    ShowInput_Path=False,
    SynchronousSolve=True)
loop_readline_txt = Hops(
    Filename=panel_4,
    CacheResultsInMemory=True,
    CacheSolveResults=True,
    RemoteDefinitionLocation="http://127.0.0.1:5000/loop_readline_txt",
    RemoteSolveVersion=(0, 1, 0),
    ShowInput_Enabled=False,
    ShowInput_Path=False,
    SynchronousSolve=True)
seek_10_txt = Hops(
    Filename=panel_6,
    Pointer="75",
    CacheResultsInMemory=False,
    CacheSolveResults=False,
    RemoteDefinitionLocation="http://127.0.0.1:5000/seek_10_txt",
    RemoteSolveVersion=(0, 1, 0),
    ShowInput_Enabled=False,
    ShowInput_Path=False,
    SynchronousSolve=True)
enumerated_txt_2 = Hops(
    Filename=panel_5,
    CacheResultsInMemory=True,
    CacheSolveResults=True,
    RemoteDefinitionLocation="http://127.0.0.1:5000/enumerated_txt",
    RemoteSolveVersion=(0, 1, 0),
    ShowInput_Enabled=False,
    ShowInput_Path=False,
    SynchronousSolve=True)
tell_test_txt = Hops(
    Filename=panel_9,
    CacheResultsInMemory=True,
    CacheSolveResults=True,
    RemoteDefinitionLocation="http://127.0.0.1:5000/tell_test_txt",
    RemoteSolveVersion=(0, 1, 0),
    ShowInput_Enabled=False,
    ShowInput_Path=False,
    SynchronousSolve=True)  # -> Contents, Pointer
open_txt = Hops(
    Filename=panel,
    CacheResultsInMemory=False,
    CacheSolveResults=False,
    RemoteDefinitionLocation="http://127.0.0.1:5000/open_txt",
    RemoteSolveVersion=(0, 1, 0),
    ShowInput_Enabled=False,
    ShowInput_Path=False,
    SynchronousSolve=True)
open_utf_8 = Hops(
    Filename="person.txt",
    CacheResultsInMemory=True,
    CacheSolveResults=True,
    RemoteDefinitionLocation="http://127.0.0.1:5000/open_UTF-8",
    RemoteSolveVersion=(0, 1, 0),
    ShowInput_Enabled=False,
    ShowInput_Path=False,
    SynchronousSolve=True)
read_txt = Hops(
    Filename=panel_2,
    CacheResultsInMemory=True,
    CacheSolveResults=True,
    RemoteDefinitionLocation="http://127.0.0.1:5000/read_txt",
    RemoteSolveVersion=(0, 1, 0),
    ShowInput_Enabled=False,
    ShowInput_Path=False,
    SynchronousSolve=True)
readlines_txt = Hops(
    Filename="Colors.txt",
    CacheResultsInMemory=True,
    CacheSolveResults=True,
    RemoteDefinitionLocation="http://127.0.0.1:5000/readlines_txt",
    RemoteSolveVersion=(0, 1, 0),
    ShowInput_Enabled=False,
    ShowInput_Path=False,
    SynchronousSolve=True)
readline_txt = Hops(
    Filename=panel_3,
    CacheResultsInMemory=True,
    CacheSolveResults=True,
    RemoteDefinitionLocation="http://127.0.0.1:5000/readline_txt",
    RemoteSolveVersion=(0, 1, 0),
    ShowInput_Enabled=False,
    ShowInput_Path=False,
    SynchronousSolve=True)
loop_txt = Hops(
    Filename="Colors.txt",
    CacheResultsInMemory=True,
    CacheSolveResults=True,
    RemoteDefinitionLocation="http://127.0.0.1:5000/loop_txt",
    RemoteSolveVersion=(0, 1, 0),
    ShowInput_Enabled=False,
    ShowInput_Path=False,
    SynchronousSolve=True)
# WORKING WITH LIBRARIES
# 
# 
# # python all-in-one for dummies, second edition
# # Working with External Files
# # folders and directories
# # creating, reading, writing, and deleting files
# 
# # Understanding Text and Binary Files
hops = Hops(
    CacheResultsInMemory=True,
    CacheSolveResults=True,
    RemoteSolveVersion=(0, 1, 0),
    ShowInput_Enabled=False,
    ShowInput_Path=False,
    SynchronousSolve=True)
panel_12 = Panel(append_new_txt)
panel_13 = Panel(enumerated_txt)
panel_14 = Panel(open_txt)
panel_15 = Panel(open_utf_8)
panel_16 = Panel(read_txt)
panel_17 = Panel(readlines_txt)
panel_18 = Panel(readline_txt)
panel_19 = Panel(loop_txt)
panel_20 = Panel(enumerated_txt_2)
panel_21 = Panel(loop_readline_txt)
panel_22 = Panel(loop_counter_readline_txt)
panel_23 = Panel(tell_test_txt.Pointer)
panel_24 = Panel(tell_test_txt.Contents)
panel_25 = Panel(seek_10_txt)
# CREATIVE SANDBOX AT WICKERSON STUDIO
panel_26 = Panel("quotes_copy.txt")
tell_test_txt_2 = Hops(
    Filename=panel_26,
    CacheResultsInMemory=False,
    CacheSolveResults=False,
    RemoteDefinitionLocation="http://127.0.0.1:5000/tell_test_txt",
    RemoteSolveVersion=(0, 1, 0),
    ShowInput_Enabled=False,
    ShowInput_Path=False,
    SynchronousSolve=True)  # -> Contents, Pointer
panel_27 = Panel(tell_test_txt_2.Contents)
panel_28 = Panel(tell_test_txt_2.Pointer)
sine = Sine(Value=panel_28)
cosine = Cosine(Value=panel_28)
division = Division(A=Slider(100, range=0..100), B=panel_28)
construct_point = ConstructPoint(XCoordinate=cosine, YCoordinate=sine, ZCoordinate=division)
sphere = Sphere(Base=construct_point, Radius=cosine)
cone = Cone(Base=construct_point, Radius=cosine, Length=construct_point)  # -> Cone, Tip
cap_holes = CapHoles(Brep=cone.Cone)
solid_difference = SolidDifference(BrepsA=sphere, BrepsB=cap_holes)
number_slider = Slider(10, range=0..10)
deconstruct_brep = DeconstructBrep(Brep=solid_difference)  # -> Faces, Edges, Vertices
divide_surface = DivideSurface(Surface=graft(deconstruct_brep.Faces), UCount=number_slider, VCount=number_slider)  # -> Points, Normals, Parameters
interpolate = Interpolate(Vertices=divide_surface.Points, Degree=3, Periodic=False, KnotStyle=1)  # -> Curve, Length, Domain
clean_tree = CleanTree(RemoveNulls=True, RemoveInvalid=True, RemoveEmpty=Toggle(True), Tree=interpolate.Curve)
param_viewer = ParamViewer(clean_tree)
param_viewer_2 = ParamViewer(interpolate.Curve)
multipipe = MultiPipe(
    Curves=clean_tree,
    NodeSize=Slider(0.1, range=0..1),
    EndOffset=1,
    StrutSize=1,
    Segment=0,
    KinkAngle=0.6,
    CubeFit=0,
    Caps="1")
