# Grasshopper definition WS_Example_002.gh (Grasshopper 1.0.7)
# plug-ins: Hops

# NUMPY: Python's Wildly Important Library!!!
# DATA SCIENCE
# 
# # python one-liners
# # chapter 3
# #Bacis Two-Dimensional Array Arithmetic
# # The Basics
number_slider = Slider(1, range=0..10)
array_a1d = Hops(
    Value1=number_slider,
    Value2=Slider(0, range=0..10),
    Value3=Slider(0, range=0..10),
    CacheResultsInMemory=True,
    CacheSolveResults=True,
    RemoteDefinitionLocation="http://127.0.0.1:5000/array_A1D",
    RemoteSolveVersion=(0, 1, 0),
    ShowInput_Enabled=False,
    ShowInput_Path=False,
    SynchronousSolve=True)
array_a1d_2 = Hops(
    Value1=Slider(1, range=0..10),
    Value2=Slider(1, range=0..10),
    Value3=Slider(1, range=0..10),
    CacheResultsInMemory=True,
    CacheSolveResults=True,
    RemoteDefinitionLocation="http://127.0.0.1:5000/array_A1D",
    RemoteSolveVersion=(0, 1, 0),
    ShowInput_Enabled=False,
    ShowInput_Path=False,
    SynchronousSolve=True)
array_a1d_3 = Hops(
    Value1=Slider(2, range=0..10),
    Value2=Slider(0, range=0..10),
    Value3=Slider(0, range=0..10),
    CacheResultsInMemory=True,
    CacheSolveResults=True,
    RemoteDefinitionLocation="http://127.0.0.1:5000/array_A1D",
    RemoteSolveVersion=(0, 1, 0),
    ShowInput_Enabled=False,
    ShowInput_Path=False,
    SynchronousSolve=True)
panel = Panel(array_a1d_2)
panel_2 = Panel(array_a1d)
panel_3 = Panel(array_a1d_3)
array_a3d = Hops(
    List1=panel_2,
    List2=panel,
    List3=panel_3,
    CacheResultsInMemory=True,
    CacheSolveResults=True,
    RemoteDefinitionLocation="http://127.0.0.1:5000/array_A3D",
    RemoteSolveVersion=(0, 1, 0),
    ShowInput_Enabled=False,
    ShowInput_Path=False,
    SynchronousSolve=True)
array_a2d = Hops(
    List1=panel_2,
    List2=panel,
    CacheResultsInMemory=True,
    CacheSolveResults=True,
    RemoteDefinitionLocation="http://127.0.0.1:5000/array_A2D",
    RemoteSolveVersion=(0, 1, 0),
    ShowInput_Enabled=False,
    ShowInput_Path=False,
    SynchronousSolve=True)
# Array Arithmetic
panel_4 = Panel(array_a2d)
panel_5 = Panel(array_a3d)
# array_Add
# array_Sub
# array_Mul
# array_Div
array_add = Hops(
    List1=panel_2,
    List2=panel,
    List3=panel_3,
    List4=panel_2,
    List5=panel,
    List6=panel_3,
    CacheResultsInMemory=True,
    CacheSolveResults=True,
    RemoteDefinitionLocation="http://127.0.0.1:5000/array_Add",
    RemoteSolveVersion=(0, 1, 0),
    ShowInput_Enabled=False,
    ShowInput_Path=False,
    SynchronousSolve=True)
array_sub = Hops(
    List1=panel_2,
    List2=panel,
    List3=panel_3,
    List4=panel_2,
    List5=panel,
    List6=panel_3,
    CacheResultsInMemory=True,
    CacheSolveResults=True,
    RemoteDefinitionLocation="http://127.0.0.1:5000/array_Sub",
    RemoteSolveVersion=(0, 1, 0),
    ShowInput_Enabled=False,
    ShowInput_Path=False,
    SynchronousSolve=True)
array_mul = Hops(
    List1=panel_2,
    List2=panel,
    List3=panel_3,
    List4=panel_2,
    List5=panel,
    List6=panel_3,
    CacheResultsInMemory=True,
    CacheSolveResults=True,
    RemoteDefinitionLocation="http://127.0.0.1:5000/array_Mul",
    RemoteSolveVersion=(0, 1, 0),
    ShowInput_Enabled=False,
    ShowInput_Path=False,
    SynchronousSolve=True)
array_div = Hops(
    List1=panel_2,
    List2=panel,
    List3=panel_3,
    List4=panel_2,
    List5=panel,
    List6=panel_3,
    CacheResultsInMemory=True,
    CacheSolveResults=True,
    RemoteDefinitionLocation="http://127.0.0.1:5000/array_Div",
    RemoteSolveVersion=(0, 1, 0),
    ShowInput_Enabled=False,
    ShowInput_Path=False,
    SynchronousSolve=True)
panel_6 = Panel(array_add)
panel_7 = Panel(array_div)
panel_8 = Panel(array_sub)
panel_9 = Panel(array_mul)
# element-wise multiplication of two-D arrays is
# called the Hadamard product
number_slider_2 = Slider(0.1, range=0..1)
# Let's tackle this problem by using the salary data of Mike, Beth, and Oscar.
# It seems that Mike has had the highest salary but
# he is actually bringing home less due to tax rates.
number_slider_3 = Slider(99, range=0..100)
# array_minmaxavg
# array_Example_01
# access=hs.HopsParamAccess.LIST
# array_Example_01
array_minmaxavg = Hops(
    List1=panel_2,
    List2=panel,
    List3=panel_3,
    CacheResultsInMemory=True,
    CacheSolveResults=True,
    RemoteDefinitionLocation="http://127.0.0.1:5000/array_minmaxavg",
    RemoteSolveVersion=(0, 1, 0),
    ShowInput_Enabled=False,
    ShowInput_Path=False,
    SynchronousSolve=True)  # -> Min, Max, Average
panel_10 = Panel([array_minmaxavg.Min, array_minmaxavg.Max, array_minmaxavg.Average])
series = Series(Start=number_slider_3, Step=Slider(2, range=-5..5), Count="3")
series_2 = Series(Start=Slider(110, range=0..110), Step=Slider(-3, range=-5..5), Count="3")
series_3 = Series(Start=Slider(90, range=0..110), Step=Slider(-3, range=-5..5), Count="3")
series_4 = Series(Start=Slider(0.2, range=0..1), Step=Slider(0.05, range=0..1), Count="3")
series_5 = Series(Start=Slider(0.4, range=0..1), Step=Slider(0.1, range=0..1), Count="3")
series_6 = Series(Start=Slider(0.1, range=0..1), Step=number_slider_2, Count="3")
# CREATIVE SANDBOX AT WICKERSON STUDIO
panel_11 = Panel(series)
panel_12 = Panel(series_2)
panel_13 = Panel(series_3)
panel_14 = Panel(series_4)
panel_15 = Panel(series_5)
panel_16 = Panel(series_6)
top_income2 = Hops(
    Mike=panel_11,
    Beth=panel_12,
    Oscar=panel_13,
    Mike_tax=panel_14,
    Beth_tax=panel_15,
    Oscar_tax=panel_16,
    CacheResultsInMemory=True,
    CacheSolveResults=True,
    RemoteDefinitionLocation="http://127.0.0.1:5000/top_income2",
    RemoteSolveVersion=(0, 1, 0),
    ShowInput_Enabled=False,
    ShowInput_Path=False,
    SynchronousSolve=True)
# in ($1000)
panel_17 = Panel(top_income2)
